# Grasshopper definition MoonDome.gh (Grasshopper 1.0.7)

# ---- group: RH_IN:radius
number_slider = Slider(2, range=0..10)

# ---- group: RH_IN:offset
offset = Slider(1.774, range=0..10)

# ---- group: RH_IN:path
number_slider_2 = Slider(18, range=0..100)

# ----
xy_plane = XYPlane(Origin=Point(0, 0, 0))
circle = Circle(Plane=xy_plane, Radius=number_slider)
offset_curve = OffsetCurve(Curve=circle, Distance=offset, Plane=PlaneXY(0, 0, 0), Corners=1)
divide_curve = DivideCurve(Curve=circle, Count=number_slider_2, Kinks=False)  # -> Points, Tangents, Parameters
divide_curve_2 = DivideCurve(Curve=offset_curve, Count=number_slider_2, Kinks=False)  # -> Points, Tangents, Parameters
dispatch = Dispatch(List=divide_curve_2.Points, DispatchPattern=[True, False])  # -> ListA, ListB
dispatch_2 = Dispatch(List=divide_curve.Points, DispatchPattern=[True, False])  # -> ListA, ListB
point = Point(dispatch_2.ListA)
point_2 = Point(dispatch.ListB)
weave = Weave(Pattern=[0, 1], Stream0=point, Stream1=point_2, NullGaps=False)

# ---- group: RH_IN:step
number_slider_3 = Slider(0.08, range=0..1)

# ---- group: RH_IN:count
number_slider_4 = Slider(92, range=0..100)

# ---- group: RH_IN:piperadius
number_slider_5 = Slider(0.07, range=0..0.1)

# ----
series = Series(Start=0, Step=number_slider_3, Count=number_slider_4)
nurbs_curve = NurbsCurve(Vertices=weave, Degree=3, Periodic=True)  # -> Curve, Length, Domain
unit_z = UnitZ(Factor=series)
move = Move(Geometry=nurbs_curve.Curve, Motion=unit_z)  # -> Geometry, Transform
area = Area(Geometry=move.Geometry)  # -> Area, Centroid

# ---- group: RH_IN:rotation
number_slider_6 = Slider(7, range=0..10)

# ----
division = Division(A=number_slider_4, B=number_slider_6)
range = Range(Domain=Domain(0, 1), Steps=division)
graph_mapper = GraphMapper(range, x0=0, x1=1, y0=0, y1=1, container_name="Sine", Equation_px=[0, 0.5264238119], Equation_py=[0.5828530788, 1])
multiplication = Multiplication(A=graph_mapper, B=Slider(25, range=0..360))
repeat_data = RepeatData(Data=multiplication, Length=number_slider_4)
radians = Radians(Degrees=repeat_data)
rotate = Rotate(Geometry=move.Geometry, Angle=radians, Plane=area.Centroid)  # -> Geometry, Transform
range_2 = Range(Domain=Domain(0, 1), Steps=number_slider_4)
graph_mapper_2 = GraphMapper(
    range_2,
    x0=0,
    x1=1,
    y0=0,
    y1=1,
    container_name="Bezier",
    cpx=[0, 0, 0.4989691973, 1],
    cpy=[0.9067896008, 0.9540062547, 0.9612703323, 0.4273595214])
multiplication_2 = Multiplication(A=graph_mapper_2, B=Slider(1, range=1..5))
scale = Scale(Geometry=rotate.Geometry, Center=area.Centroid, Factor=multiplication_2)  # -> Geometry, Transform
pipe = Pipe(Curve=scale.Geometry, Radius=number_slider_5, Caps=0)

# ---- group: RH_OUT:toolpaths
crv = Curve(scale.Geometry)

# ---- group: RH_OUT:Dome
mesh = Mesh(pipe)

# ----
custom_preview = CustomPreview(Geometry=pipe, Material=ColourSwatch(SwatchColor=RGB(217, 212, 212)))
