# Grasshopper definition spiralmoire.gh (Grasshopper 1.0.7)

rectangle = Rectangle({Plane=PlaneXY(4.5, 6, 0), Size=Domain2(u=-4.5..4.5, v=-6..6)})
radius = Slider(8, range=0..10)
polygon_center = PolygonCenter(Polyline=rectangle)  # -> CenterV, CenterE, CenterA
populate_2d = Populate2D(Region=rectangle, Count=5, Seed=1)
circle_cnr = CircleCNR(Center=polygon_center.CenterA, Normal=Vector(0, 0, 1), Radius=radius)
cycles = Slider(121, range=1..200)
divide_curve = DivideCurve(Curve=circle_cnr, Count=20, Kinks=False)  # -> Points, Tangents, Parameters
offset_distance = Slider(0.0033, range=0..0.01)
duplicate_data = DuplicateData(Data=divide_curve.Points, Number=cycles, Order=True)
vec2pt = Vector2Pt(PointA=duplicate_data, PointB=polygon_center.CenterA, Unitize=False)  # -> Vector, Length
lng = ListLength(List=duplicate_data)
series = Series(Start=0, Step=offset_distance, Count=lng)
amp = Amplitude(Vector=vec2pt.Vector, Amplitude=series)
move = Move(Geometry=duplicate_data, Motion=amp)  # -> Geometry, Transform
closest_point = ClosestPoint(Point=move.Geometry, Cloud=populate_2d)  # -> ClosestPoint, CPIndex, Distance

# ---- group: RH_IN:amplitude
amplitude = Slider(0.1, range=0.1..1.1)

# ----
vector_2pt = Vector2Pt(PointA=closest_point.ClosestPoint, PointB=move.Geometry, Unitize=False)  # -> Vector, Length
amplitude_2 = Amplitude(Vector=vector_2pt.Vector, Amplitude=amplitude)
move_2 = Move(Geometry=move.Geometry, Motion=amplitude_2)  # -> Geometry, Transform
interpolate = Interpolate(Vertices=move_2.Geometry, Degree=3, Periodic=False, KnotStyle=1)  # -> Curve, Length, Domain
end_points = EndPoints(Curve=interpolate.Curve)  # -> Start, End

# ---- group: RH_IN:rotation
rotation = Slider(0.49, range=0..1)

# ----
rotate = Rotate(Geometry=interpolate.Curve, Angle=degrees(rotation), Plane=end_points.End)  # -> Geometry, Transform
trim_with_region = TrimWithRegion(Curve=[interpolate.Curve, rotate.Geometry], Region=rectangle)  # -> Inside, Outside

# ---- group: RH_OUT:curves
curve = Curve(trim_with_region.Inside)
